# Grasshopper definition example_file.gh (Grasshopper 1.0.7)
# plug-ins: g3gh Info

getfolder = GetCurrentFolder()  # -> path
# ---------- getfolder: Python ----------
__author__ = "joelhilmersson"

import rhinoscriptsyntax as rs

import os


if(ghdoc.Path):
    path = os.path.dirname(ghdoc.Path)
# ---------- end getfolder ----------
concat = Concatenate(FragmentA=getfolder, FragmentB="stanfordbunny.obj", JoinSeparator="/")
dmshfromobj = ReadFromFile(FilePath=concat)
setcols = SetMeshVertexColours(Mesh=dmshfromobj, Colours=ColourSwatch(SwatchColor=RGB(255, 255, 255)))
edgeloops = MeshBoundaryEdgeLoops(DMesh3=setcols)
msmsh = MeshMeasurements(Mesh=setcols)  # -> Area, Volume
edgestats = MeshEdgeStatistics(Mesh=setcols)  # -> MaxEdgeLength, MinEdgeLength, AverageEdgeLength
iterholefill = IterativeMeshHoleFill(DMesh3=setcols, EdgeLength=1)
reduce = ReduceMesh(Mesh=setcols, NumberOfFaces=Slider(500, range=0..1000), ConstrainEdges=True, ProjectToInput=True)
laplacesmooth = SmoothMesh(Mesh=iterholefill, InteriorWeight=Slider(0.1, range=0..0.1))
mesh = Mesh(laplacesmooth)
